# Grasshopper definition postgres_port.gh (Grasshopper 1.0.7)
# plug-ins: MouseSelection, RemoSharp

panel = Panel("C:\Users\akhaj\source\repos\CollaborativeGeometryServer\local_db\local_db.json")
button = Button()
xy = XYPlane(Origin=Point(0, 0, 0))
file = ReadFile(File=panel, PerLineParse=False)
rtf = ReadTreeFile(Json=file, ResetPlane=xy, ResetZShift=0, RESET=button)  # -> BonsaiTree, Json, Breps, Colors

config = Slider(0, range=0..10)

writetofile = WriteToFile(Write=button, TxtContent=rtf.Json, FilePath=panel)
serializetb = SerializeTBranch(TBranches=rtf.BonsaiTree)
submit = Button()
nickname = PoolConnection(Url="ws://localhost:8080", Connect=Toggle(True))
button_2 = Button()
trigger = Trigger(Interval=100, TimerInterval=100, Target=c_script)
c_script = CSharpScript(z=button_2, x=submit)  # -> out, A, B; inputs x: Boolean
# ---------- c_script: C# usings ----------
using System.Threading.Tasks;
# ---------- c_script: C# ----------
      
    counter++;
  
    if (x) counter = 0;
    
    if (counter == 3)
    {
      this.GrasshopperDocument.ScheduleSolution(1, doc => {
        
        Grasshopper.Kernel.Special.GH_ButtonObject button = 
          (Grasshopper.Kernel.Special.GH_ButtonObject) this.Component.Params.Input[0].Sources[0];
        button.ButtonDown = true;
        button.ExpireSolution(true);
        });
    }
    else if (counter == 6)
    {
      this.GrasshopperDocument.ScheduleSolution(1, doc => {
        
        Grasshopper.Kernel.Special.GH_ButtonObject button = 
          (Grasshopper.Kernel.Special.GH_ButtonObject) this.Component.Params.Input[0].Sources[0];
        button.ButtonDown = false;
        button.ExpireSolution(true);
        });
    }
# ---------- c_script: C# additional code ----------
  int counter = 10;
# ---------- end c_script ----------
or = GateOr(A=button_2, B=Button())
mouseselection = MouseSelection(Run=Toggle(True), Branches=nickname, Reset=or, ModifyMode=Toggle(False))  # -> SelectedBranch, SecondaryBranch
toggle = BooleanToggle(True)
clean = CleanTree(
    RemoveNulls=True,
    RemoveInvalid=True,
    RemoveEmpty=False,
    Tree=[mouseselection.SelectedBranch, mouseselection.SecondaryBranch])
lng = ListLength(List=clean)
nickname_2 = PoolTree(Ws=nickname)
swatch = ColourSwatch(SwatchColor=RGB(117, 201, 168))
equals = Equality(FirstNumber="1", SecondNumber=lng)  # -> Equality, Inequality
item = ListItem(List=clean, Index=0, Wrap=True)  # -> Item, Item1
lng_2 = ListLength(List=clean)
addtbranch = AddTBranch(
    Ws=nickname,
    Selection=mouseselection.SelectedBranch,
    User_name="arastoo2",
    Color=swatch,
    ADD=False,
    MouseClicks=equals.Equality)  # -> Preivew, Circle, Serliazed, TBranch
detbranch = DeconstructTBranch(TBranch=nickname_2)  # -> Branch_id, Placement_plane, Orientable_planes, Borders, User_name, Color, Status, Parents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
singlet = SingleTrueFilter(Trigger=nickname_2, Boolean=submit)
equals_2 = Equality(FirstNumber="2", SecondNumber=lng_2)  # -> Equality, Inequality
computebridge = ComputeBridge(
    Run=equals_2.Equality,
    Shift_a=Slider(-0.09, range=-0.45..0.45),
    Shift_b=Slider(0.091, range=-0.45..0.45),
    Shift_ab=Slider(0.323, range=-1..1),
    Branch_a=item.Item,
    Branch_b=item.Item1)
c_script_2 = CSharpScript(color=swatch, trs=Slider(150, range=0..255))  # -> out, A, B; inputs color: Color, trs: Int32
# ---------- c_script_2: C# ----------
    A = System.Drawing.Color.FromArgb(trs, color.R, color.G, color.B);
    B = color;
# ---------- end c_script_2 ----------
preview = CustomPreview(Geometry=detbranch.Brep, Material=detbranch.Color)
preview_2 = CustomPreview(Geometry=addtbranch.Preivew, Material=c_script_2.A)
preview_3 = CustomPreview(Geometry=addtbranch.Circle, Material=c_script_2.B)
branch = TreeBranch(Tree=computebridge, Path=config, MaintainPaths=True)
python = GhPythonScript(x=branch)  # -> a, b; inputs x: list
# ---------- python: Python ----------
__author__ = "akhaj"
__version__ = "2025.09.02"

import rhinoscriptsyntax as rs

a = x[0].placement_plane
b = x[1].placement_plane
# ---------- end python ----------
singlet_2 = SingleTrueFilter(Trigger=item.Item, Boolean=submit)
bridge = GenrateBridge(
    Branches=nickname,
    Plane1=python.a,
    Plane2=python.b,
    Selection1=item.Item,
    Selection2=item.Item1,
    User_name="arastoo2",
    Color=swatch,
    ADD=singlet_2)  # -> Preivew, Serliazed, TBranch
merge = Merge(Data1=addtbranch.TBranch, Data2=bridge.TBranch)
flatten = FlattenTree(Tree=merge, Path="{0}")
clean_2 = CleanTree(RemoveNulls=True, RemoveInvalid=True, RemoveEmpty=False, Tree=flatten)
nickname_3 = SubmitSingleBranch(Ws=nickname, Branch=clean_2, Submit=singlet)
